% Simulink data dictionary BatteryDCDC.sldd

PlntDCDCEff = 98
PlntDCDCTimeCnst = 0.001
PlntDCDCVoltInit = 650
PlntBattIdealVolt = 400
PlntBattIdealSoc = 80
PlntDCDCPwrLmt = 120000

Contact = enum(DefaultValue="Open", StorageType="int8")
  Init = 0
  Open = 1
  Close = 2

PlntBattModNumCellPar = 31
PlntBattModNumCellSer = 24
PlntBattNumMod = 4
PlntBattTempInitDegC = 25
PlntBattSocInit = 0.6
PlntBattCntctrClsdRes = 0.0001
PlntBattCntctrOpenCond = 1.0e-8
PlntBattCntctrThresh = 0.9
PlntBattPreChrgRes = 20
PlntBattPreChrgCap = 10000
PlntBattPreChrgCapSerRes = 1.0e-9
PlntBattPreChrgCapParCond = 0
PlntBattBleedRes = 20
PlntBattBalSwtchClsdRes = 0.01
PlntBattBalSwtchOpenCond = 1.0e-8
PlntBattBalSwtchThresh = 0
PlntBattCondArea = 0.0037
PlntBattCondThick = 0.001
PlntBattThermCond = 205
PlntDCDCEffCurrVec = [-500 -1 1 500]
PlntDCDCEffTmpVec = [280 300 320]
PlntDCDCInitTemp = 300
PlntDCDCMaxCurr = 500
PlntDCDCOutVoltDroop = 0.1
PlntDCDCThermMass = 100
PlntDCDCZeroOutPwrLoss = 1
PlntDCDCFltrCap = 100
PlntDCDCFltrRes = 1.0e-6
PlntDCDCLossV = [0 200 400 600 800 1000]

PlntDCDCLossTbl = [100 100 100 100 100
 100 150 200 250 300
 100 200 300 400 500
 100 250 400 550 700
 100 300 500 700 900
 100 350 600 850 1100]

PlntDCDCLossI = [0 25 50 75 100]
PlntBattTimeCnst = 0.001
PlntBattChrgMax = 4.8
PlntBattCapInit = 2.88
PlntBattNumCellSer = 96
PlntBattNumCellPar = 31
PlntBattOpenCirctVolt = [2.8 3.228 3.284 3.361 3.408 3.427 3.472 3.477 3.493 3.504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 4.221]
PlntBattVoltSocBpt = [0 0.01 0.02 0.03 0.04 0.05 0.06 0.07 0.08 0.09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 1]

PlntBattIntrnRes = [0.008846 0.009319 0.009027 0.00847 0.01032 0.01314
 0.006389 0.006554 0.005553 0.005525 0.006043 0.007805
 0.004364 0.004101 0.00406 0.003452 0.003846 0.004517
 0.002031 0.002563 0.002532 0.00246 0.002716 0.003047
 0.001443 0.001825 0.001795 0.001778 0.001924 0.002234
 0.0005603 0.0007192 0.0006887 0.0007557 0.0007355 0.001014
 0.001028 0.001338 0.001 0.001536 0.001546 0.002789]

PlntBattTempBpt = [243.1 253.1 263.1 273.1 283.1 298.1 313.1]
PlntBattSocBpt = [0 0.2 0.4 0.6 0.8 1]