% Simulink data dictionary Driver.sldd

DriverAeroRes = 0.5
DriverPositionGainR = 0.25
DriverDelayGain = 0.01
DriverYawRateGain = 0.2
DriverPositionGainF = 6
DriverDrivelineRes = 10
DriverInitialGear = 0
DriverPreviewDist = 4
DriverRollRes = 800
DriverShiftTime = 0.1
DriverTimeConst = 0.3
DriverTractiveForce = 8000
DriverFrontCornerStiff = 40000
DriverRearCornerStiff = 40000
DriverWheelRange = 1.0472