% Simulink data dictionary SimpleEngine.sldd

PlntEngLhv = Simulink.Parameter(46000000, DataType="double")
PlntEngSg = Simulink.Parameter(0.754)
PlntEngBsfcAvg = Simulink.Parameter(350)
PlntEngTqMot = Simulink.Parameter([0 8 10 14 18 22 24 27 34])
PlntEngTqMotBpt = Simulink.Parameter([0 500 1000 2000 3000 4000 4500 5000 6000])
PlntEngTqMaxFric = Simulink.Parameter([0 4 5.2 8 10.5 13 14 15 17])
PlntEngTqMaxBpt = Simulink.Parameter([0 750 1054 1357 1661 1964 2268 2571 2875 3179 3482 3786 4089 4393 4696 5000 6000 7000], DataType="double")
PlntEngTqMax = Simulink.Parameter([71 71 95 127 167 224 227 228 227 226 225 224 222 221 220 219 180 140], DataType="double")
PlntEngFuelSpdVec = Simulink.Parameter([1000 6000])
PlntEngFuelTrqVec = Simulink.Parameter([0 400])
PlntEngSpdThresh = Simulink.Parameter(100)